# Grasshopper definition base_.gh (Grasshopper 0.9.76)

# ----
# Creating the Room
fixed_floor_area = Panel("200")
width_of_the_room = Slider(20, range=6..33)
angle_of_rotation = Slider(45, range=0..180)
division = Division(A=fixed_floor_area, B=width_of_the_room)
length_of_the_room = Panel(division)
box = DomainBox(Base=PlaneXY(0, 0, 0), X=width_of_the_room, Y=length_of_the_room, Z="3.2")
volume = Volume(Geometry=box)  # -> Volume, Centroid
# radiation analysis
# summerRadiation to be minimized
# winterRadiation to be maximized
# daylighting analysis
# sDA to be maximized
# structural analysis
rotate = Rotate(Geometry=box, Angle=degrees(angle_of_rotation), Plane=volume.Centroid)  # -> Geometry, Transform
