# Grasshopper definition cap_2.1_volume_superfície.gh (Grasshopper 0.9.76)
# plug-ins: Python Interpreter

xy = XYPlane(Origin=Point(0, 0, 0))
xy_2 = XYPlane(Origin=Point(0, 0, 0))
python = PythonScript(plane=xy)  # -> out, sph; inputs plane: Plane
# ---------- python: Python ----------
import rhinoscriptsyntax as rs
import math

pt = 0,0,0
radius = 1
height = 2
width = 2

sph = rs.AddSphere(pt, radius)
area = 4 * math.pi * radius**2
print(area)
volume = (4/3) * math.pi * radius**3
print(volume)
relacao = area/volume
print(relacao)


cyl = rs.AddCylinder(pt, height, radius, cap=True)
# ---------- end python ----------
square = PythonScript(lado=Slider(2, range=0..10), plane=xy_2)  # -> out, sqr; inputs plane: Plane
# ---------- square: Python ----------
#Square module
import rhinoscriptsyntax as rs

if lado == None: lado = 5.00
#if plane == None: plane = UV

class Quadrado():
    ###Define um quadrado###

    def __init__(self, lado):
        self.lado = lado
        print(lado)

    def calculaArea(self):
        area = self.lado * self.lado
        print('area = %d' %area)

    def createrSqr(self):
        shape = rs.AddRectangle(plane, self.lado, self.lado)
        return shape



"""
    def método para preencher ou não o objeto:
        if == True:
            preencher
        else:
            não preencher

    # Define método para alterar default (ñ funciona)
    def setX(self, new_lado):
        self.lado = new_lado

    def getX(self):
        return self.lado
"""


#cria a instância quadrado
quadrado = Quadrado(lado)

quadrado.calculaArea()
sqr = quadrado.createrSqr()
# ---------- end square ----------
panel = Panel(square.out)
srf = Surface(square.sqr)
